# Dynamo graph create_callout.dyn (Dynamo 2.6.1.8786)
# packages: PyScript 0.0.7

offset = DoubleInput(1.5)  # graph input
rotate = BoolSelector(true)  # graph input
list_create = List.Create(item0=offset, item1=rotate)
execute = PyScript.Script.Execute(IN=list_create)
log = Watch(execute.output)  # graph output
return_ = Watch(execute.OUT)  # graph output
